# Grasshopper definition IceMolds.gh (Grasshopper 1.0.7)

sphere_radius = Slider(20.855, range=0..60)
sphere = Sphere(Base=PlaneXY(0, 0, 0), Radius=sphere_radius)
sphere_2 = Sphere(Base=PlaneXY(0, 0, 0), Radius=Slider(3, range=0..10))
rectangle = Rectangle(Plane=PlaneXY(0, 0, 0), XSize=Slider(50, range=0..200), YSize=Slider(50, range=0..200), Radius=0)  # -> Rectangle, Length
vector_xyz = VectorXYZ(XComponent=Slider(-20, range=-100..100), YComponent=Slider(-20, range=-100..100), ZComponent=Slider(0, range=-100..100))  # -> Vector, Length
sphere_3 = Sphere(Base=PlaneXY(0, 0, 0), Radius=Slider(3, range=0..30))
cylinder = Cylinder(Base=PlaneXY(0, 0, 0), Radius=Slider(2, range=0..30), Length=Slider(4, range=0..30))
vector_xyz_2 = VectorXYZ(
    XComponent=Slider(-25, range=-100..100),
    YComponent=Slider(-25, range=-100..100),
    ZComponent=Slider(-25, range=-100..100))  # -> Vector, Length
vector_xyz_3 = VectorXYZ(XComponent=Slider(-25, range=-100..100), YComponent=Slider(-25, range=-100..100), ZComponent=Slider(0, range=-100..100))  # -> Vector, Length
vector_xyz_4 = VectorXYZ(XComponent=Slider(0, range=-100..100), YComponent=Slider(0, range=-100..100), ZComponent=Slider(25, range=-100..100))  # -> Vector, Length
vector_xyz_5 = VectorXYZ(XComponent=0, YComponent=0, ZComponent=Slider(20, range=-100..100))  # -> Vector, Length
box_rectangle = BoxRectangle(Rectangle=rectangle.Rectangle, Height=Slider(25, range=0..120))
move = Move(Geometry=sphere_2, Motion=vector_xyz.Vector)  # -> Geometry, Transform
move_2 = Move(Geometry=sphere_3, Motion=vector_xyz_4.Vector)  # -> Geometry, Transform
move_3 = Move(Geometry=box_rectangle, Motion=vector_xyz_3.Vector)  # -> Geometry, Transform
move_4 = Move(Geometry=cylinder, Motion=vector_xyz_5.Vector)  # -> Geometry, Transform
move_5 = Move(Geometry=box_rectangle, Motion=vector_xyz_2.Vector)  # -> Geometry, Transform
polar_array = PolarArray(Geometry=move.Geometry, Plane=PlaneXY(0, 0, 0), Count=Slider(4, range=0..10), Angle=6.283185307)  # -> Geometry, Transform
sphere_radius_2 = Slider(26.58, range=0..60)
sphere_4 = Sphere(Base=PlaneXY(0, 0, 0), Radius=sphere_radius_2)
sphere_5 = Sphere(Base=PlaneXY(0, 0, 0), Radius=Slider(4, range=0..10))
rectangle_2 = Rectangle(Plane=PlaneXY(0, 0, 0), XSize=Slider(60, range=0..200), YSize=Slider(60, range=0..200), Radius=0)  # -> Rectangle, Length
vector_xyz_6 = VectorXYZ(XComponent=Slider(-24, range=-100..100), YComponent=Slider(-24, range=-100..100), ZComponent=Slider(0, range=-100..100))  # -> Vector, Length
sphere_6 = Sphere(Base=PlaneXY(0, 0, 0), Radius=Slider(3, range=0..30))
cylinder_2 = Cylinder(Base=PlaneXY(0, 0, 0), Radius=Slider(2, range=0..30), Length=Slider(4, range=0..30))
vector_xyz_7 = VectorXYZ(
    XComponent=Slider(-30, range=-100..100),
    YComponent=Slider(-30, range=-100..100),
    ZComponent=Slider(-30, range=-100..100))  # -> Vector, Length
vector_xyz_8 = VectorXYZ(XComponent=Slider(-30, range=-100..100), YComponent=Slider(-30, range=-100..100), ZComponent=Slider(0, range=-100..100))  # -> Vector, Length
vector_xyz_9 = VectorXYZ(XComponent=Slider(0, range=-100..100), YComponent=Slider(0, range=-100..100), ZComponent=Slider(30, range=-100..100))  # -> Vector, Length
vector_xyz_10 = VectorXYZ(XComponent=0, YComponent=0, ZComponent=Slider(24, range=-100..100))  # -> Vector, Length
box_rectangle_2 = BoxRectangle(Rectangle=rectangle_2.Rectangle, Height=Slider(30, range=0..120))
move_6 = Move(Geometry=sphere_5, Motion=vector_xyz_6.Vector)  # -> Geometry, Transform
move_7 = Move(Geometry=sphere_6, Motion=vector_xyz_9.Vector)  # -> Geometry, Transform
move_8 = Move(Geometry=box_rectangle_2, Motion=vector_xyz_8.Vector)  # -> Geometry, Transform
move_9 = Move(Geometry=cylinder_2, Motion=vector_xyz_10.Vector)  # -> Geometry, Transform
move_10 = Move(Geometry=box_rectangle_2, Motion=vector_xyz_7.Vector)  # -> Geometry, Transform
polar_array_2 = PolarArray(Geometry=move_6.Geometry, Plane=PlaneXY(0, 0, 0), Count=Slider(4, range=0..10), Angle=6.283185307)  # -> Geometry, Transform
