# Grasshopper definition Clips.gh (Grasshopper 1.0.7)

width = Slider(3.1, range=-10..10)
multiplication = Multiplication(A=width, B=Slider(0.5, range=-10..10))
z_height = Slider(30, range=0..30)
addition = Addition(A=multiplication, B=Slider(30, range=0..50))
division = Division(A=width, B=Slider(-2, range=-10..10))
rectangle = Rectangle(Plane=PlaneXY(0, 0, 0), XSize=addition, YSize=width, Radius=0)  # -> Rectangle, Length
rectangle_2 = Rectangle(Plane=PlaneXY(0, 0, 0), XSize=width, YSize=addition, Radius=0)  # -> Rectangle, Length
vector_xyz = VectorXYZ(XComponent=division, YComponent=division, ZComponent=0)  # -> Vector, Length
box_rectangle = BoxRectangle(Rectangle=rectangle.Rectangle, Height=z_height)
box_rectangle_2 = BoxRectangle(Rectangle=rectangle_2.Rectangle, Height=z_height)
vector_xyz_2 = VectorXYZ(XComponent=division, YComponent=division, ZComponent=0)  # -> Vector, Length
move = Move(Geometry=box_rectangle_2, Motion=vector_xyz.Vector)  # -> Geometry, Transform
move_2 = Move(Geometry=box_rectangle, Motion=vector_xyz_2.Vector)  # -> Geometry, Transform
sphere = Sphere(Base=PlaneXY(0, 0, 0), Radius=Slider(30, range=0..30))
group = Group(Objects=[move_2.Geometry, move.Geometry])
