# Grasshopper definition NestedShapes.gh (Grasshopper 1.0.7)

number_slider = Slider(3, range=0..12)
radius = Slider(4, range=0..20)
radius_2 = Slider(12, range=0..20)
radius_3 = Slider(8, range=0..30)
radius_4 = Slider(12, range=0..20)
radius_5 = Slider(14, range=0..20)
radius_6 = Slider(13.853, range=0..20)
addition = Addition(A=radius_2, B=Slider(1.853, range=0..12))
addition_2 = Addition(A=radius_4, B=Slider(6, range=0..12))
offsetdistance = Slider(6, range=0..20)
offsetdistance_2 = Slider(4, range=0..20)
offsetdistance_3 = Slider(10, range=0..20)
polygon = Polygon(Plane=PlaneXY(0, 0, 0), Radius=radius_3, Segments=number_slider, FilletRadius=0)  # -> Polygon, Length
polygon_2 = Polygon(Plane=PlaneXY(0, 0, 0), Radius=radius, Segments=number_slider, FilletRadius=0)  # -> Polygon, Length
polygon_3 = Polygon(Plane=PlaneXY(0, 0, 0), Radius=radius_4, Segments=Slider(4, range=0..12), FilletRadius=0)  # -> Polygon, Length
polygon_4 = Polygon(Plane=PlaneXY(0, 0, 0), Radius=radius_2, Segments=Slider(6, range=0..12), FilletRadius=0)  # -> Polygon, Length
polygon_5 = Polygon(Plane=PlaneXY(0, 0, 0), Radius=radius_5, Segments=Slider(6, range=0..12), FilletRadius=0)  # -> Polygon, Length
polygon_6 = Polygon(Plane=PlaneXY(0, 0, 0), Radius=addition_2, Segments=Slider(4, range=0..12), FilletRadius=0)  # -> Polygon, Length
offsetdistance_4 = Slider(2.356, range=0..20)
offsetdistance_5 = Slider(20, range=0..20)
rotate = Rotate(Geometry=polygon.Polygon, Angle=Slider(1, range=0..10), Plane=PlaneXY(0, 0, 0))  # -> Geometry, Transform
offsetdistance_6 = Slider(12, range=0..60)
offsetdistance_7 = Slider(5, range=0..20)
offset_curve = OffsetCurve(Curve=polygon_2.Polygon, Distance=offsetdistance, Plane=PlaneXY(0, 0, 0), Corners=1)
offset_curve_2 = OffsetCurve(Curve=polygon_3.Polygon, Distance=offsetdistance_3, Plane=PlaneXY(0, 0, 0), Corners=1)
offsetdistance_8 = Slider(24, range=0..60)
rotate_2 = Rotate(Geometry=polygon_5.Polygon, Angle=1.570796327, Plane=PlaneXY(0, 0, 0))  # -> Geometry, Transform
rotate_3 = Rotate(Geometry=polygon_6.Polygon, Angle=offsetdistance_4, Plane=PlaneXY(0, 0, 0))  # -> Geometry, Transform
offsetdistance_9 = Slider(14, range=0..20)
offset_curve_3 = OffsetCurve(Curve=polygon_4.Polygon, Distance=offsetdistance_2, Plane=PlaneXY(0, 0, 0), Corners=1)
offsetdistance_10 = Slider(6, range=0..20)
offset_curve_4 = OffsetCurve(Curve=offset_curve_2, Distance=offsetdistance_5, Plane=PlaneXY(0, 0, 0), Corners=1)
offset_curve_5 = OffsetCurve(Curve=rotate.Geometry, Distance=offsetdistance_6, Plane=PlaneXY(0, 0, 0), Corners=1)
offset_curve_6 = OffsetCurve(Curve=offset_curve, Distance=offsetdistance_8, Plane=PlaneXY(0, 0, 0), Corners=1)
offset_curve_7 = OffsetCurve(Curve=rotate_3.Geometry, Distance=offsetdistance_9, Plane=PlaneXY(0, 0, 0), Corners=1)
offset_curve_8 = OffsetCurve(Curve=rotate_2.Geometry, Distance=offsetdistance_7, Plane=PlaneXY(0, 0, 0), Corners=1)
offset_curve_9 = OffsetCurve(Curve=offset_curve_3, Distance=offsetdistance_10, Plane=PlaneXY(0, 0, 0), Corners=1)
group = Group(Objects=[offset_curve_6, offset_curve_5, offset_curve, rotate.Geometry])
group_2 = Group(Objects=[offset_curve_4, offset_curve_7, offset_curve_2, rotate_3.Geometry, polygon_3.Polygon])
group_3 = Group(Objects=[offset_curve_9, offset_curve_8, offset_curve_3, rotate_2.Geometry, polygon_4.Polygon])
