# Grasshopper definition Lamp2Screws.gh (Grasshopper 1.0.7)

circle = Circle(Plane=PlaneXY(0, 0, 0), Radius=1)
rectangle = Rectangle(Plane=PlaneXY(0, 0, 0), XSize=Slider(-9, range=-100..100), YSize=Slider(15, range=0..100), Radius=0)  # -> Rectangle, Length
vector_xyz = VectorXYZ(XComponent=Slider(4.5, range=-100..100), YComponent=Slider(23.5, range=0..100), ZComponent=0)  # -> Vector, Length
move = Move(Geometry=rectangle.Rectangle, Motion=vector_xyz.Vector)  # -> Geometry, Transform
polar_array = PolarArray(Geometry=move.Geometry, Plane=PlaneXY(0, 0, 0), Count=Slider(6, range=0..8), Angle=6.283185307)  # -> Geometry, Transform
